# Grasshopper definition 幕墙光污染.gh (Grasshopper 1.0.7)

number_slider = Slider(25, range=0..30)
panel = Panel("F:\Archive Chrome Download\CHN_Henan.Zhengzhou.570830_CSWD\CHN_Henan.Zhengzhou.570830_CSWD.epw")
curve = Curve(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)
importepw = LBImportEPW(epw_file=panel)  # -> location, dry_bulb_temperature, dew_point_temperature, relative_humidity, wind_speed, wind_direction, direct_normal_rad, diffuse_horizontal_rad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; plug-in component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
rectangle = Rectangle(Plane=PlaneXY(0, 0, 0), XSize=number_slider, YSize=number_slider, Radius=0)  # -> Rectangle, Length
analysisperiod = LBAnalysisPeriod(
    start_month=Slider(1, range=1..12),
    start_day=Slider(10, range=1..31),
    start_hour=Slider(8, range=8..17),
    end_month=Slider(2, range=1..12),
    end_day=Slider(20, range=1..31),
    end_hour=Slider(17, range=8..17),
    timestep=Slider(2, range=1..3))  # -> period, hoys, dates; plug-in component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
area = Area(Geometry=rectangle.Rectangle)  # -> Area, Centroid
divide_curve = DivideCurve(Curve=curve, Count=Slider(40, range=0..100), Kinks=False)  # -> Points, Tangents, Parameters
rotate = Rotate(Geometry=rectangle.Rectangle, Angle=degrees(Slider(25, range=0..90)), Plane=area.Centroid)  # -> Geometry, Transform
sunpath = LBSunPath(location=importepw.location, hoys=analysisperiod.hoys, scale=1)  # -> out, vectors, altitudes, azimuths, hoys, sun_pts, analemma, daily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; plug-in component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
unit_z = UnitZ(Factor=Slider(60, range=0..100))
reverse = Reverse(Vector=divide_curve.Tangents)
extrude = Extrude(Base=rotate.Geometry, Direction=unit_z)
deconstruct_brep = DeconstructBrep(Brep=extrude)  # -> Faces, Edges, Vertices
list_item = ListItem(List=deconstruct_brep.Faces, Index=Slider(1, range=0..5), Wrap=True)

unit_z_2 = UnitZ(Factor=1)
rotate_2 = Rotate(Vector=graft(reverse), Axis=unit_z_2, Angle=degrees([Slider(-30, range=-30..30), Slider(30, range=-30..30)]))
circle = Circle(Plane=divide_curve.Points, Radius=Slider(100, range=0..100))
line_sdl = LineSDL(Start=graft(divide_curve.Points), Direction=rotate_2, Length=Slider(100, range=0..100))
curve_curve = CurveCurve(CurveA=graft(circle), CurveB=line_sdl)  # -> Points, ParamsA, ParamsB
shift_paths = ShiftPaths(Data=curve_curve.ParamsA, Offset=-1)
shatter = Shatter(Curve=graft(circle), Parameters=shift_paths)
list_item_2 = ListItem(List=shatter, Index=Slider(0, range=0..1), Wrap=True)
shift_paths_2 = ShiftPaths(Data=list_item_2, Offset=-1)
merge = Merge(Data1=shift_paths_2, Data2=line_sdl)
join_curves = JoinCurves(Curves=merge, Preserve=False)  # -> flatten(Curves)
surface_curve = SurfaceCurve(Surface=list_item, Curve=join_curves)  # -> Curves, simplify(Points), UVPoints, Normals, Parameters, Tangents
clean_tree = CleanTree(RemoveNulls=True, RemoveInvalid=True, RemoveEmpty=True, Tree=surface_curve.Points)
tree_statistics = TreeStatistics(Tree=clean_tree)  # -> Paths, Length, Count
deconstruct_path = DeconstructPath(Branch=tree_statistics.Paths)  # -> flatten(Indices)

project = Project(Geometry=sunpath.vectors, Plane=list_item)  # -> Geometry, Transform
plane_normal = PlaneNormal(Origin=Point(0, 0, 0), ZAxis=project.Geometry)
mirror = Mirror(Geometry=sunpath.vectors, Plane=plane_normal)  # -> Geometry, Transform

reverse_2 = Reverse(Vector=mirror.Geometry)
md_slider = MDSlider(SliderMode=0, slider_value=Point(0.5, 0.5, 0.5), x_domain=Domain(0, 1), y_domain=Domain(0, 1), z_domain=Domain(0, 1))
evaluate_surface = EvaluateSurface(Surface=reparameterize(list_item), Point=md_slider)  # -> Point, Normal, UDirection, VDirection, Frame
amplitude = Amplitude(Vector=reverse_2, Amplitude=Slider(20, range=0..20))
vector_display_ex = VectorDisplayEx(Point=evaluate_surface.Point, Vector=amplitude, Colour=RGB(0, 0, 0), Width=Slider(3, range=0..20))

panel_2 = Panel(deconstruct_path)

list_item_3 = ListItem(List=reverse, Index=deconstruct_path, Wrap=True)
rotate_3 = Rotate(Vector=list_item_3, Axis=unit_z_2, Angle=degrees(Slider(90, range=0..100)))
reverse_3 = Reverse(Vector=rotate_3)
rotate_4 = Rotate(Vector=list_item_3, Axis=reverse_3, Angle=degrees(Slider(20, range=0..100)))  # -> graft(Vector)
deconstruct_vector = DeconstructVector(Vector=rotate_4)  # -> XComponent, YComponent, ZComponent
deconstruct_vector_2 = DeconstructVector(Vector=rotate_2)  # -> XComponent, YComponent, ZComponent
bounds = Bounds(Numbers=deconstruct_vector_2.YComponent)
bounds_2 = Bounds(Numbers=[deconstruct_vector_2.ZComponent, deconstruct_vector.ZComponent])
bounds_3 = Bounds(Numbers=deconstruct_vector_2.XComponent)
panel_3 = Panel(bounds)
deconstruct_vector_3 = DeconstructVector(Vector=mirror.Geometry)  # -> XComponent, YComponent, ZComponent
includes = Includes(Value=deconstruct_vector_3.XComponent, Domain=bounds_3)  # -> Includes, Deviation
includes_2 = Includes(Value=deconstruct_vector_3.YComponent, Domain=bounds)  # -> Includes, Deviation
includes_3 = Includes(Value=deconstruct_vector_3.ZComponent, Domain=bounds_2)  # -> Includes, Deviation
addition = Addition(A=includes.Includes, B=includes_2.Includes, C=includes_3.Includes)
larger_than = LargerThan(FirstNumber=addition, SecondNumber=Slider(2, range=0..10))  # -> flatten(LargerThan), OrEqualTo

mass_addition = MassAddition(Input=larger_than.LargerThan)  # -> Result, PartialResults
panel_4 = Panel(mass_addition.Result)
